vi "ldpcDecoding.gvi"   [LabVIEW NXG]
inputs:
  "ReceivedMessage": i32[]
  "CheckMatrix": f64[][]
  "itMax": i32
outputs:
  "MesageDecoded": i32[]
panel controls:
  "WaitBetweenIteration": bool
panel indicators:
  "Syndrom": f64[]
  "loop iteration": i32
  "Variable: indicator": f64[]
  "Variable: out": i32[]
  "error": i32
  "sizeMatrix": i32[]
  "sizeMessage": i32
diagram:
  s1 = $ReceivedMessage  # shift register
  while (iteration -> i1) {
    call "A x Vector.gvi"(A=$CheckMatrix, Vector=s1) -> (A x Vector=w1, error=w2)
    Quotient And Remainder(x=w1, y=2) -> (x-y*floor(x/y)=w3)
    $Syndrom <- w3
    $error <- w2
    Math Node("syndrom"=w3, "H"=$CheckMatrix, "in"=s1) -> ("out"=w4, "indicator"=w5)
    ~~~
    count=0;

    m=size(H,1);    % Number of checks
    n=size(H,2);    % Number of bits in codeword
    k=n-m;


        % Find the checks that are not respected
        syndrom;

        % For each bit count the number of checks respected and not respected
        res=zeros(1,n);
        notRes=zeros(1,n);

        indicator=[m n size(H) size(syndrom)];
        for bit=1:n
            for check=1:m
                if H(check, bit)==1
                    if syndrom(1, check)==1
                        notRes(bit)=notRes(bit)+1;
                    else
                        res(bit)=res(bit)+1;
                    end
                end
            end
        end

        % if more not respected flip the bit
        for bit=1:n
            if notRes(bit)>res(bit)
                in(bit)=mod(in(bit)+1,2);
            end
        end
        out=in;
    ~~~
    $"Variable: out" <- w4
    Array Size(array=$CheckMatrix) -> (size(s)=w6)
    $sizeMatrix <- w6
    $"Variable: indicator" <- w5
    Array Size(array=s1) -> (size(s)=w7)
    $sizeMessage <- w7
    case ($WaitBetweenIteration) {
      frame False, Default { }
      frame True {
        Wait Ms(msToWait=1500)
      }
    }
    $"loop iteration" <- i1
    Add Array Elements(numeric array=w3) -> (sum=w8)
    Is Equal To 0(x=w8) -> w9
    Is Greater(x=i1, y=$itMax) -> w10
    Logical Or(w10, w9) -> w11
    next s1 = w4
    stop if w11
  }
  Array Size(array=$CheckMatrix) -> (size(s)=w12)
  Array Index(array=w12) -> (out0[0]=w13)
  Array Index(array=w12) -> (out0[1]=w14)
  Subtract(x=w14, y=w13) -> w15
  Array Subset(array=s1, index0=w13, length0=w15) -> w16
  $MesageDecoded <- w16
