vi "ldpcDenseCoding.gvi"   [LabVIEW NXG]
inputs:
  "Message": f64[]
  "generatorMatrix": f64[][]
outputs:
  "EncodedMessage": f64[]
panel indicators:
  "error": i32
diagram:
  Array Size(array=$generatorMatrix) -> (size(s)=w1)
  Array Index(array=w1) -> (out0[0]=w2)
  call "Create Special Real Matrix.gvi"(matrix size=w2) -> (special matrix=w3)
  Build Array[ConcatenateInputs=True]($generatorMatrix, w3) -> w4
  call "A x Vector.gvi"(A=w4, Vector=$Message) -> (A x Vector=w5, error=w6)
  Quotient And Remainder(x=w5, y=2) -> (x-y*floor(x/y)=w7)
  $EncodedMessage <- w7
  $error <- w6
