vi "Rx_main.gvi"   [LabVIEW NXG]
panel controls:
  "IQ rate": f64 = 500000
  "carrier frequency": f64 = 2449500000
  "gain": f64 = 20
  "PSK type": enum{"normal", "shifted", "offset"} = "normal"
  "samples per symbol": i32 = 16
  "M-PSK": i32 = 4
  "modulation type": T1 = "PSK"
  "pulse shaping filter": T2 = "Root Raised Cos"
  "filter parameter": f64 = 0.5
  "stopFetchingLoop": bool
  "packet_size_with_padding": f64 = 10624
  "wanted_sync_index": f64 = 80
  "correction": f64 = 0.4
  "multiple": f64 = 100
  "soundSamplesPerPacket": i32 = 128
  "bitsPerSample": i32 = 8
  "uLaw": bool
  "CheckMatrixLocation": path
  "LDPC": bool
  "LDPCitMax": i32
  "codingRate": f64 = 1
  "interleving": bool
  "lengthInterleaver": f64
  "toleranceInterleaver": f64
  "FastOrSlowDemod": enum{"Slow", "Fast"} = "Fast"
  "Use MathScript?": bool
  "resetPacketRecord": bool
panel indicators:
  "Demodulated IQ Graph": T3[]
  "SoundOutput": waveform<f64>[]
  "loop iteration": i32
  "ILFoundSync": bool
  "signal_power": f64
  "noise_power": f64
  "Energy Threshold": f64
  "SNR_dB": f64
  "iterPerSecond": f64
  "current_sync_index": f64
  "last10Inrange": bool
  "NumOfSamp": f64
types:
  T1 = enum{"FSK", "PSK", "QAM", "MSK", "PAM", "ASK", "CPM"}
  T2 = enum{"none", "Raised Cosine", "Root Raised Cos", "Gaussian"}
  T3 = cluster{"constellation": f64[], "oversampled data": f64[]}
  T4 = cluster{"sample rate": f64, "number of channels": i32, "bits per sample": i32}
  T5 = cluster{"samples per symbol (16)": i32, "symbol map": c128[], "differential PSK": enum{"disable", "enable"}, "PSK type": enum{"normal", "shifted", "offset"}}
  T6 = cluster{"expected sync location (symbols)": i32, "sync sequence": c128[], "sync location uncertainty (symbols)": i32, "sync indent (symbols)": i32}
  T7 = cluster{"psk_system_params": T5, "pulse_shaping_filter_coeffs": f64[], "matched_filter_coeffs": f64[], "sync_params": T6, "sync_seq_bits": i8[]}
diagram:
  w1 = $LDPC
  case (w1) {
    frame False, Default {
      w2 = default
      w3 = default
    }
    frame True {
      call "Read from Spreadsheet File (DBL).gvi"(file path=$CheckMatrixLocation, format="%.3f", delimiter=",") -> (all rows=w3)
      w2 = $LDPCitMax
    }
  }
  w4 = $wanted_sync_index
  w5 = $packet_size_with_padding
  w6 = $interleving
  w7 = $soundSamplesPerPacket
  w8 = $bitsPerSample
  w9 = $correction
  w10 = $multiple
  w11 = T4 {"sample rate"=6000, "number of channels"=1, "bits per sample"=8}
  w12 = $FastOrSlowDemod
  call "niUSRP Open Rx Session.gvi"(Device names="192.168.10.2") -> (Error Out=w13, Session handle=w14)
  call "niUSRP Configure Signal.gvi"(session handle=w14, IQ rate=$"IQ rate", carrier frequency=$"carrier frequency", gain=$gain, error in (no error)=w13, active antenna="RX1") -> (session handle out=w15, Error Out=w16)
  call "niUSRP Initiate.gvi"(session handle=w15, error in (no error)=w16) -> (session handle out=w17, Error Out=w18)
  call "initPSK.gvi"(PSK type=$"PSK type", samples per symbol=$"samples per symbol", M-PSK=$"M-PSK", modulation type=$"modulation type", pulse shaping filter=$"pulse shaping filter", filter parameter=$"filter parameter", PSK_params_in=T7 {all zero or empty}) -> (PSK_params_out=w19)
  call "Sound Output Configure.gvi"(device ID=0, sound format=w11, number of samples per channel=8000) -> (task ID=w20, error out=w21)
  call "Sound Output Start.gvi"(task ID=w20, error in=w21) -> (task ID out=w22, error out=w23)
  w24 = cluster{"t0": f64, "dt": f64, "Y": c128[]} {all zero or empty}
  w25 = $"Use MathScript?"
  w26 = $lengthInterleaver
  w27 = $toleranceInterleaver
  s1 = w24  # shift register
  s2 = uninitialised  # shift register
  s3 = uninitialised  # shift register
  s4 = i8[] []  # shift register
  s5 = uninitialised  # shift register
  while (iteration -> i1) {
    Is Greater Than 0(x=i1) -> w28
    case (w12) {
      frame "Slow", Default {
        call "slowDemodBlock.gvi"(data=s1, PSK_params_in=w19) -> (output bit stream=w30, recovered complex waveform=w31, sync found index=w29)
        call "MT Format Constellation.gvi"(waveform=w31) -> (constellation graph=w32)
        $"Demodulated IQ Graph" <- w32
      }
      frame "Fast" {
        call "fastDemodBlock.gvi"(data=s1, PSK_params_in=w19) -> (output bit stream=w30, sync found index=w29)
      }
    }
    case (w28) {
      frame False, Default {
        w33 = w5
        w34 = w17
        w35 = w18
        w36 = FALSE
        w37 = w5
      }
      frame True {
        Not(x=w28) -> w38
        call "adjustSamplesToSync.gvi"(wanted_sync_index=w4, current_sync_index=w29, packet_size_with_padding=w5, first_interation?=w38, sync_index_last_iteration=s2, samples_last_interation=s3) -> (new_NumOfSamples=w33, last10InRange=w36)
        w34 = w17
        w35 = w18
        w37 = w33
      }
    }
    call "niUSRP Fetch Rx Data (CDB Cluster).gvi"(session handle=w34, number of samples=w33, error in (no error)=w35) -> (session handle out=w39, data=w40, Error Out=w41)
    call "SignalAndNoiseEstimate.gvi"(Use MathScript?=w25, data=w40) -> (signal_power=w42, noise_power=w43, Energy Threshold=w44, SNR_dB=w45)
    $signal_power <- w42
    call "calcPacketsPerSecond.gvi"(last5InRange=w36, firstIterValuesIn=s5, loop iteration=i1) -> (iterPerSecond=w46, firstIterValuesOut=w47)
    $iterPerSecond <- w46
    $noise_power <- w43
    $"Energy Threshold" <- w44
    $SNR_dB <- w45
    $last10Inrange <- w36
    $NumOfSamp <- w37
    $"loop iteration" <- i1
    $current_sync_index <- w29
    Multiply(w7, w8) -> w48
    case (w1) {
      frame False, Default {
        w49 = w48
      }
      frame True {
        Multiply(w48, $codingRate) -> w49
      }
    }
    case (w6) {
      frame False, Default {
        w50 = w49
      }
      frame True {
        Add(w49, 10) -> w50
      }
    }
    call "extractDataBits.gvi"(appendedArray=s4, dataBitsPerPacket=w50) -> (dataArray=w51)
    case (w6) {
      frame False, Default {
        w52 = w51
        w53 = default
        w54 = default
      }
      frame True {
        call "Deinterleaver.gvi"(input=w51, lengthInterleaver=w26, tolerance=w27) -> (queueOut=w55, queueErrorOut=w56, foundSynchro=w57)
        Get Queue Status(error in (no error)=w56, queue=w55) -> (error out=w58, queue out=w59)
        Dequeue Element(error in (no error)=w58, queue=w59, timeout in ms (-1)=20) -> (element=w52, error out=w54, queue out=w53)
        $ILFoundSync <- w57
      }
    }
    case (w1) {
      frame False, Default {
        w60 = w52
      }
      frame True {
        call "ldpcDecoding.gvi"(ReceivedMessage=w52, CheckMatrix=w3, itMax=w2) -> (MesageDecoded=w60)
      }
    }
    call "soundBitStream2Integer.gvi"(bitStream=w60, numberOfSoundSamples=w7, bitsPerSample=w8) -> (integerArray=w61)
    case ($uLaw) {
      frame False, Default {
        To Double Precision Float(number=w61) -> w62
      }
      frame True {
        call "uLawDecodeArray8to16bits.gvi"(X=w61) -> (Y=w62)
      }
    }
    call "deShiftAndMultSoundArray.gvi"(unprocessedSoundArray=w62, correction=w9, multiple=w10) -> (processedArray=w63)
    Property Node(instance in=w11) -> ("sample rate"=w64)
    Reciprocal(x=w64) -> w65
    Build Waveform Node(Y=w63, dt=w65, t0=1904-01-01T00:00:00Z) -> (output waveform=w66)
    Build Array(w66, waveform<f64> {dt=1, Y=[]}) -> w67
    $SoundOutput <- w67
    call "Sound Output Write.gvi"(task ID=w22, data=w67, error in=w23) -> (task ID out=w68, error out=w69)
    Array Size(array=w60) -> (size(s)=w70)
    Is Equal(x=w70, y=1024) -> w71
    case (w71) {
      frame False, Default { }
      frame True {
        call "recordPacketErrors.gvi"(packet=w60, reset=$resetPacketRecord, sync=w29)
      }
    }
    next s1 = w40
    next s2 = w29
    next s3 = w33
    next s4 = w30
    next s5 = w47
    stop if $stopFetchingLoop
  }
  call "niUSRP Abort.gvi"(Handle in=w39, error in (no error)=w41) -> (Handle out=w72, Error Out=w73)
  call "niUSRP Close Session.gvi"(Handle in=w72, error in (no error)=w73)
  Flush Queue(error in (no error)=w54, queue=w53) -> (error out=w74, queue out=w75)
  Release Queue(error in (no error)=w74, queue=w75)
  call "Sound Output Stop.gvi"(task ID=w68, error in=w69) -> (task ID out=w76, error out=w77)
  call "Sound Output Clear.gvi"(task ID=w76, error in=w77)
