vi "Tx_main.gvi"   [LabVIEW NXG]
panel controls:
  "IQ_Rate": f64 = 500000
  "f0": f64 = 2450000000
  "Gain": f64 = 10
  "modulation type": T1 = "PSK"
  "PSK type": enum{"normal", "shifted", "offset"} = "normal"
  "samples per symbol": i32 = 16
  "pulse shaping filter": T2 = "Root Raised Cos"
  "filter parameter": f64 = 0.5
  "filter length": i32 = 8
  "stopRecoringSound": bool
  "stopDataEnqueing": bool
  "stopSendingData": bool
  "SamplesPerChannel": i32 = 128
  "multiple": f64 = 1000
  "correction": f64 = 0.02
  "bitsPerSample": i32 = 8
  "uLaw": bool
  "LDPC": bool
  "GeneratorMatrixLocation": path
panel indicators:
  "data": waveform<f64>[]
  "PacketGraph": cluster{"t0": f64, "dt": f64, "Y": c128[]}
  "IQ Graph": T3[]
  "numOfElementInRadioQueue2": i32
  "numOfElementInSoundQueue": i32
  "numOfElementInSoundQueue2": i32
  "numOfElementInRadioQueue": i32
types:
  T1 = enum{"FSK", "PSK", "QAM", "MSK", "PAM", "ASK", "CPM"}
  T2 = enum{"none", "Raised Cosine", "Root Raised Cos", "Gaussian"}
  T3 = cluster{"constellation": f64[], "oversampled data": f64[]}
  T4 = cluster{"sample rate": f64, "number of channels": i32, "bits per sample": i32}
diagram:
  w1 = $SamplesPerChannel
  w2 = $bitsPerSample
  w3 = $correction
  w4 = $multiple
  Obtain Queue(element data type=i8[] [], max queue size (-1, unlimited)=2000, name (unnamed)="sound_bit_stream") -> (error out=w5, queue out=w6)
  w7 = T4 {"sample rate"=6000, "number of channels"=1, "bits per sample"=16}
  call "Sound Input Configure.gvi"(device ID=0, sound format=w7, sample mode=1, number of samples per channel=8000) -> (task ID=w8, error out=w9)
  call "Sound Input Start.gvi"(task ID=w8, error in=w9) -> (task ID out=w10, error out=w11)
  while {
    Multiply(w1, w2) -> w12
    call "Sound Input Read.gvi"(task ID=w10, error in=w11, number of samples per channel=w1, timeout=-1) -> (task ID out=w13, data=w14, error out=w15)
    for {
      w16 = each element of w14
      Property Node(instance in=w16) -> ("Y"=w17)
    }
    call "shiftAndMultSoundArray.gvi"(soundArray_raw=w17, correction=w3, multiply=w4) -> (processedSoundArray=w18)
    case ($uLaw) {
      frame False, Default {
        To Unsigned Byte Integer(number=w18) -> w19
      }
      frame True {
        call "uLawCodeArray16to8.gvi"(X=w18) -> (Y=w19)
      }
    }
    call "intArray2BitStream.gvi"(unsigned 8-bit integer=w19) -> (array=w20)
    Reshape Array(inArray=w20, size=w12) -> w21
    case ($LDPC) {
      frame False, Default {
        w22 = w21
      }
      frame True {
        call "ldpcDenseCoding.gvi"(Message=w21, GeneratorMatrixLocation=$GeneratorMatrixLocation) -> (EncodedMessage=w22)
      }
    }
    call "createPacket.gvi"(dataBitStream=w22) -> (packet=w23)
    Get Queue Status(error in (no error)=w5, queue=w6) -> (# elements in queue=w24, error out=w25, queue out=w26)
    Lossy Enqueue Element(element=w23, error in (no error)=w25, queue=w26)
    $data <- w14
    $numOfElementInSoundQueue <- w24
    stop if $stopRecoringSound
  }
  call "Sound Input Stop.gvi"(task ID=w13, error in=w15) -> (task ID out=w27, error out=w28)
  call "Sound Input Clear.gvi"(task ID=w27, error in=w28)
  w29 = $"samples per symbol"
  w30 = $"PSK type"
  w31 = $"modulation type"
  w32 = $"pulse shaping filter"
  w33 = $"filter parameter"
  w34 = $"filter length"
  w35 = cluster{"t0": f64, "dt": f64, "Y": c128[]} {"t0"=0, "dt"=1, "Y"=[]}
  Obtain Queue(element data type=w35, max queue size (-1, unlimited)=5000, name (unnamed)="enqueDataForRadio") -> (error out=w36, queue out=w37)
  call "niUSRP Open Tx Session.gvi"(Device names="192.168.10.2", Reset=TRUE) -> (Error Out=w38, Session handle=w39)
  call "niUSRP Configure Signal.gvi"(session handle=w39, IQ rate=$IQ_Rate, carrier frequency=$f0, gain=$Gain, error in (no error)=w38, active antenna="TX1") -> (session handle out=w40, coerced IQ rate=w41)
  while {
    Get Queue Status(error in (no error)=w5, queue=w6) -> (# elements in queue=w42, error out=w43, queue out=w44)
    Dequeue Element(error in (no error)=w43, queue=w44) -> (element=w45, error out=w46, queue out=w47)
    call "modulation_block.gvi"(modulation type=w31, PSK type=w30, pulse shaping filter=w32, filter parameter=w33, filter length=w34, input bit stream=w45, samples per symbol=w29, IQ_Rate=w41) -> (modulated_complex_waveform=w48)
    Get Queue Status(error in (no error)=w46, queue=w37) -> (# elements in queue=w49, error out=w50, queue out=w51)
    Lossy Enqueue Element(element=w48, error in (no error)=w50, queue=w51)
    $numOfElementInSoundQueue2 <- w42
    $numOfElementInRadioQueue <- w49
    stop if $stopDataEnqueing
  }
  Flush Queue(queue=w47) -> (queue out=w52)
  Release Queue(queue=w52)
  while {
    Get Queue Status(error in (no error)=w36, queue=w37) -> (# elements in queue=w53, error out=w54, queue out=w55)
    Dequeue Element(error in (no error)=w54, queue=w55) -> (element=w56, queue out=w57)
    call "addPadding.gvi"(dataIn=w56) -> (paddedDataOut=w58)
    call "niUSRP Write Tx Data (CDB Cluster).gvi"(session handle=w40, data=w58, end of data?=$stopSendingData) -> (session handle out=w59, Error Out=w60)
    $PacketGraph <- w58
    call "MT Format Constellation.gvi"(waveform=w58) -> (constellation graph=w61)
    $"IQ Graph" <- w61
    $numOfElementInRadioQueue2 <- w53
    stop if $stopSendingData
  }
  Flush Queue(queue=w57) -> (queue out=w62)
  Release Queue(queue=w62)
  call "niUSRP Close Session.gvi"(Handle in=w59, error in (no error)=w60)
