vi "Tx_soundtobitstream.gvi"   [LabVIEW NXG]
panel controls:
  "stop": bool
  "queue_type": i8[]
panel indicators:
  "File Length (bits)": i32
  "dt": f64
  "data": waveform<f64>[]
types:
  T1 = cluster{"sample rate": f64, "number of channels": i32, "bits per sample": i32}
diagram:
  w1 = T1 {"sample rate"=8000, "number of channels"=1, "bits per sample"=16}
  call "Sound Input Configure.gvi"(device ID=0, sound format=w1, number of samples per channel=8000) -> (task ID=w2, error out=w3)
  call "Sound Input Start.gvi"(task ID=w2, error in=w3) -> (task ID out=w4, error out=w5)
  Obtain Queue(element data type=$queue_type, max queue size (-1, unlimited)=200, name (unnamed)="Sound_to_bit") -> (queue out=w6)
  while {
    call "Sound Input Read.gvi"(task ID=w4, error in=w5, number of samples per channel=60) -> (task ID out=w7, data=w8, error out=w9)
    $data <- w8
    for {
      w10 = each element of w8
      Property Node(instance in=w10) -> ("Y"=w11, "dt"=w12)
      $dt <- w12
    }
    Add(w11, 0.3) -> w13
    Multiply(1000, w13) -> w14
    To Word Integer(number=w14) -> w15
    for {
      w16 = each element of w15
      Number To Boolean Array(number=w16) -> (Boolean array=w18)
      Boolean To Integer(Boolean=w18) -> (0, 1=w19)
      append w19 to w17
    }
    To Word Integer(number=w17) -> w20
    Array Size(array=w20) -> (size(s)=w21)
    Multiply Array Elements(numeric array=w21) -> (product=w22)
    Reshape Array(inArray=w20, size=w22) -> w23
    Array Size(array=w23) -> (size(s)=w24)
    $"File Length (bits)" <- w24
    Build Array[ConcatenateInputs=True](w23) -> w25
    Enqueue Element(element=w25, queue=w6)
    stop if $stop
  }
  call "Sound Input Stop.gvi"(task ID=w7, error in=w9) -> (task ID out=w26, error out=w27)
  call "Sound Input Clear.gvi"(task ID=w26, error in=w27)
